# Requirement set accounting and logging (R2024a)

## 1 [#1] Listen to order creation

## 2 [#2] Listen to order rejection by Action Approval

## 3 [#3] Listen to order confirmation from gateway

## 4 [#4] Listen to backtesting events

### 4.1 [#5] Listen to backesting initiation

### 4.2 [#6] Listen to backtesting results

## 5 [#7] Store events in data storage