# Requirement set data storage (R2024a)

## 1 [#1] Store historical data (Container)
Each parquet file corresponds to one-day tick data of different exchanges and assets, and contains the information of price and time.

## 2 [#2] Store system loggings (Container)

## 3 [#3] Provide historical market data to other module via service

## 4 [#4] Provide system loggings to UI/CLI